# Grasshopper definition GHDebugSurface.gh (Grasshopper 1.0.7)

# ---- group: SurfaceFromAGridOfPoints
srf = Surface(reparameterize(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))  # disabled
srfpt = SurfacePoints(Surface=srf)  # -> Points, Weights, Greville, UCount, VCount; disabled

# ----
# NURBS Surface_Normal_Lofted surface_ All opened curves
number_slider = Slider(2, range=0..10)
panel = Panel("""{-20.0, 0.0, 0.0}
{0.0, 0.0, 10.0}
{10.0, 0.0, 0.0}""")
panel_2 = Panel("""{-15.0, 10.0, 0.0}
{0.0, 10.0, 5.0}
{20.0, 10.0, 1.0}""")
panel_3 = Panel("""{-5.0, 25.0, 0.0}
{0.0, 25.0, 20.0}
{10.0, 25.0, 0.0}""")
panel_4 = Panel("""{-5.0, 35.0, -2.0}
{0.0, 35.0, 20.0}
{5.0, 35.0, 0.0}""")
loft_opt = LoftOptions(Closed=False, Adjust=False, Rebuild=0, Refit=0, Type=Slider(0, range=0..10))
nurbs = NurbsCurve(Vertices=panel, Degree=number_slider, Periodic=False)  # -> Curve, Length, Domain
nurbs_2 = NurbsCurve(Vertices=panel_2, Degree=number_slider, Periodic=False)  # -> Curve, Length, Domain
nurbs_3 = NurbsCurve(Vertices=panel_3, Degree=number_slider, Periodic=False)  # -> Curve, Length, Domain
nurbs_4 = NurbsCurve(Vertices=panel_4, Degree=number_slider, Periodic=False)  # -> Curve, Length, Domain
merge = Merge(Data1=nurbs.Curve, Data2=nurbs_2.Curve, Data3=nurbs_3.Curve, Data4=nurbs_4.Curve)
panel_5 = Panel("""{0.5,0.5,0.0}
{0.1,0.1,0.0}
{1.0,1.0,0.0}""")
loft = Loft(Curves=merge, Options=loft_opt)
evalsrf = EvaluateSurface(Surface=reparameterize(loft), Point=panel_5)  # -> Point, Normal, UDirection, VDirection, Frame
srfpt_2 = SurfacePoints(Surface=loft)  # -> Points, Weights, Greville, UCount, VCount
panel_6 = Panel([srfpt_2.VCount, srfpt_2.UCount])
panel_7 = Panel(evalsrf.Point)
item = ListItem(List=panel_7, Index=Slider(2, range=0..10), Wrap=True)
panel_8 = Panel(item)

# ---- group: SurfaceFrom4Points
panel_9 = Panel("{10.0, 0.0, 0.0}")  # disabled
panel_10 = Panel("{0.0, 10.0, 4.0}")  # disabled
# All these definitions were used to convalidate and developed the GeometrySharp surfaces tests.
panel_11 = Panel("{0.0, 0.0, 0.0}")  # disabled
panel_12 = Panel("{10.0, 10.0, 2.0}")  # disabled
srf4pt = _4PointSurface(CornerA=panel_11, CornerB=panel_9, CornerC=panel_12, CornerD=panel_10)  # -> reparameterize(Surface); disabled

# ----
panel_13 = Panel(srfpt.Weights)  # disabled
panel_14 = Panel(srfpt.Points)  # disabled

# ---- group: PointAt and VectorAt
panel_15 = Panel("""{0.5,0.5,0.0}
{0.1,0.1,0.0}
{1,1,0.0}
{0.3,0.5,0.0}""")  # disabled
evalsrf_2 = EvaluateSurface(Surface=srf, Point=panel_15)  # -> Point, Normal, UDirection, VDirection, Frame; disabled
panel_16 = Panel(evalsrf_2.VDirection)  # disabled
panel_17 = Panel(evalsrf_2.Point)  # disabled

# ---- group: RationalDerivatives
c_script = CSharpScript(srf=srf)  # -> out, derv0, dervs; inputs srf: Surface; disabled
# ---------- c_script: C# ----------
    Point3d pt;
    Vector3d[] derivis;
    srf.Evaluate(0.3, 0.5, 1, out pt, out derivis);
    dervs = derivis;
    derv0 = pt;
# ---------- end c_script ----------
panel_18 = Panel(c_script.derv0)  # disabled
panel_19 = Panel(c_script.dervs)  # disabled

# ----
# NURBS Surface_Loose_Lofted surface_ All opened curves
number_slider_2 = Slider(2, range=0..10)
panel_20 = Panel("""{-5.0, 25.0, 0.0}
{0.0, 25.0, 20.0}
{10.0, 25.0, 0.0}""")
panel_21 = Panel("""{-20.0, 0.0, 0.0}
{0.0, 0.0, 10.0}
{10.0, 0.0, 0.0}""")
panel_22 = Panel("""{-15.0, 10.0, 0.0}
{0.0, 10.0, 5.0}
{20.0, 10.0, 1.0}""")
panel_23 = Panel("""{-5.0, 35.0, -2.0}
{0.0, 35.0, 20.0}
{5.0, 35.0, 0.0}""")
loft_opt_2 = LoftOptions(Closed=False, Adjust=False, Rebuild=0, Refit=0, Type=Slider(1, range=0..10))
nurbs_5 = NurbsCurve(Vertices=panel_21, Degree=number_slider_2, Periodic=False)  # -> Curve, Length, Domain
nurbs_6 = NurbsCurve(Vertices=panel_22, Degree=number_slider_2, Periodic=False)  # -> Curve, Length, Domain
nurbs_7 = NurbsCurve(Vertices=panel_20, Degree=number_slider_2, Periodic=False)  # -> Curve, Length, Domain
nurbs_8 = NurbsCurve(Vertices=panel_23, Degree=number_slider_2, Periodic=False)  # -> Curve, Length, Domain
merge_2 = Merge(Data1=nurbs_5.Curve, Data2=nurbs_6.Curve, Data3=nurbs_7.Curve, Data4=nurbs_8.Curve)
panel_24 = Panel("""{0.5,0.5,0.0}
{0.1,0.1,0.0}
{1.0,1.0,0.0}""")
loft_2 = Loft(Curves=merge_2, Options=loft_opt_2)
evalsrf_3 = EvaluateSurface(Surface=reparameterize(loft_2), Point=panel_24)  # -> Point, Normal, UDirection, VDirection, Frame
srfpt_3 = SurfacePoints(Surface=loft_2)  # -> Points, Weights, Greville, UCount, VCount
panel_25 = Panel(evalsrf_3.VDirection)
panel_26 = Panel([srfpt_3.VCount, srfpt_3.UCount])
panel_27 = Panel(evalsrf_3.Point)
item_2 = ListItem(List=panel_27, Index=Slider(3, range=0..10), Wrap=True)
panel_28 = Panel(item_2)

# ----
# NURBS Surface_Tight_Lofted surface_ All opened curves
number_slider_3 = Slider(2, range=0..10)
panel_29 = Panel("""{-5.0, 25.0, 0.0}
{0.0, 25.0, 20.0}
{10.0, 25.0, 0.0}""")
panel_30 = Panel("""{-20.0, 0.0, 0.0}
{0.0, 0.0, 10.0}
{10.0, 0.0, 0.0}""")
panel_31 = Panel("""{-15.0, 10.0, 0.0}
{0.0, 10.0, 5.0}
{20.0, 10.0, 1.0}""")
panel_32 = Panel("""{-5.0, 35.0, -2.0}
{0.0, 35.0, 20.0}
{5.0, 35.0, 0.0}""")
loft_opt_3 = LoftOptions(Closed=False, Adjust=False, Rebuild=0, Refit=0, Type=Slider(2, range=0..10))
nurbs_9 = NurbsCurve(Vertices=panel_30, Degree=number_slider_3, Periodic=False)  # -> Curve, Length, Domain
nurbs_10 = NurbsCurve(Vertices=panel_31, Degree=number_slider_3, Periodic=False)  # -> Curve, Length, Domain
nurbs_11 = NurbsCurve(Vertices=panel_29, Degree=number_slider_3, Periodic=False)  # -> Curve, Length, Domain
nurbs_12 = NurbsCurve(Vertices=panel_32, Degree=number_slider_3, Periodic=False)  # -> Curve, Length, Domain
merge_3 = Merge(Data1=nurbs_9.Curve, Data2=nurbs_10.Curve, Data3=nurbs_11.Curve, Data4=nurbs_12.Curve)
panel_33 = Panel("""{0.5,0.5,0.0}
{0.1,0.1,0.0}
{1.0,1.0,0.0}""")
loft_3 = Loft(Curves=merge_3, Options=loft_opt_3)
evalsrf_4 = EvaluateSurface(Surface=reparameterize(loft_3), Point=panel_33)  # -> Point, Normal, UDirection, VDirection, Frame
srfpt_4 = SurfacePoints(Surface=loft_3)  # -> Points, Weights, Greville, UCount, VCount
panel_34 = Panel(evalsrf_4.VDirection)
panel_35 = Panel([srfpt_4.VCount, srfpt_4.UCount])
panel_36 = Panel(evalsrf_4.Point)
item_3 = ListItem(List=panel_36, Index=Slider(3, range=0..10), Wrap=True)
panel_37 = Panel(item_3)
